# Grasshopper definition gh_test.gh (Grasshopper 1.0.7)

# ---- group: Root
c_script = CSharpScript()  # -> out, RootPath
# ---------- c_script: C# usings ----------
using System.IO;
# ---------- c_script: C# ----------
    string p = this.GrasshopperDocument.FilePath;
    string pathOnly = Path.GetDirectoryName(p);
    RootPath = pathOnly;
# ---------- end c_script ----------

# ----
number_slider = Slider(1, range=0..10)

# ----
# Massing
brep = Brep(<brep referenced from the Rhino model>)
brep_2 = Brep(<brep referenced from the Rhino model>)
brep_3 = Brep(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)

concatenate = Concatenate(FragmentA=c_script.RootPath, FragmentB="\voxlizer\voxlizer_ver2.py")
panel = Panel(c_script.RootPath)
mesh = Mesh(brep)
read_file = ReadFile(File=concatenate, PerLineParse=False)

file_path = FilePath("E:\0A-Working\GH Develop\62706_VoxelizationForming\Python-code\voxlizer.py")  # disabled
read_file_2 = ReadFile(File=file_path, PerLineParse=False)  # disabled
mesh_2 = Mesh()  # disabled
ghpython_script = GhPythonScript(Code=read_file_2, Size=number_slider)  # -> Out, C, E, V; disabled
ghpython_script_2 = GhPythonScript(M=mesh_2, S=number_slider)  # -> out, V, P; inputs M: GeometryBase; disabled
# ---------- ghpython_script_2: Python ----------
"""voxelizes a mesh.
    Inputs:
        M: Mesh to be voxelized
        S: Length of each voxel (Positive float)
    Output:
        V: Voxels as a collection of breps
        P: Center points of each voxel
        """
        
import Grasshopper, GhPython
import System
import Rhino
import rhinoscriptsyntax as rs


import Rhino.Geometry as rg
import math

tmp = []

V = []
P = []

mesh = M
unit = S

if isinstance(mesh, rg.Mesh):
    
    mesh.UnifyNormals()
    mesh.Weld(math.pi)

    box = mesh.GetBoundingBox(rg.Plane.WorldXY)
    
    min_x = 9999999999999
    max_x = -min_x
    min_y = 9999999999999
    max_y = -min_y
    min_z = 9999999999999
    max_z = -min_z
    
    pts = box.GetCorners()
    
    for p in pts:
    
        if p.X > max_x:
            
            max_x = p.X
        
        if p.X < min_x:
            
            min_x = p.X
    
        if p.Y > max_y:
            
            max_y = p.Y
        
        if p.Y < min_y:
            
            min_y = p.Y
    
        if p.Z > max_z:
            
            max_z = p.Z
        
        if p.Z < min_z:
            
            min_z = p.Z

    if not unit:
                
        max_length = max(max_z - min_z, max(max_y - min_y, max_x - min_x))
                
        unit = int(max_length / 10)

    unit_interval = rg.Interval(-unit * 0.5, unit * 0.5)

    num_x = int((max_x - min_x) / unit)
    num_y = int((max_y - min_y) / unit)
    num_z = int((max_z - min_z) / unit)

    min_x = (max_x + min_x) * 0.5 - (num_x * unit * 0.5) 
    min_y = (max_y + min_y) * 0.5 - (num_y * unit * 0.5) 
    min_z = (max_z + min_z) * 0.5 - (num_z * unit * 0.5)
    
    horizontal_curves = {}
    vertical_curves   = {}
    
    horizontal_planes = {}
    vertical_planes   = {}
    
    for i in range(num_z + 1):
        
        z = min_z + i * unit
        
        p = rg.Point3d(0, 0, z)
        plane = rg.Plane(p, rg.Plane.WorldXY.Normal)
        
        curves = rg.Mesh.CreateContourCurves(mesh, plane)
        vertical_curves[z] = rg.Curve.JoinCurves(curves)
        vertical_planes[z] = plane

    
    for i in range(num_x + 1):
        
        x = min_x + i * unit
        
        p = rg.Point3d(x, 0, 0)
        plane = rg.Plane(p, rg.Plane.WorldXY.XAxis)
        
        curves = rg.Mesh.CreateContourCurves(mesh, plane)
        horizontal_curves[x] = rg.Curve.JoinCurves(curves)
        
        horizontal_planes[z] = plane

    reference_min_pt = rg.Point3d(0, 0, min_z-99999)
    reference_max_pt = rg.Point3d(0, 0, max_z+99999)
    print horizontal_curves
    for x in horizontal_curves:
        
        for curve in horizontal_curves[x]:
    
            if not isinstance(curve, rg.Polyline):
                
                curve = curve.ToPolyline()
    
            if not curve.IsClosed:
                
                curve.Add(curve.PointAt(0))
    
            min_pt = curve.ClosestPoint(reference_min_pt)
            max_pt = curve.ClosestPoint(reference_max_pt)

            for z in vertical_curves:
                
                if z < min_pt.Z or max_pt.Z < z:
                    
                    continue

                plane = vertical_planes[z]
                
                curve = curve.ToNurbsCurve()
                intersections = rg.Intersect.Intersection.CurvePlane(curve, plane, unit * 0.001)
                
                if len(intersections) < 2:
                    continue
                
                ys = []
                    
                for intersect in intersections:
                    
                    has_point = False
                    
                    for y in ys:
                        if y.DistanceTo(intersect.PointA) < 0.01:
                            has_point = True
                    
                    if not has_point:
                        ys.append(intersect.PointA)
                                
                ys = sorted(ys, key=lambda p: p.Y)  
                    
                num = int(len(ys) / 2)
                
                for i in range(num):
                    
                    local_min_y = ys[i * 2]
                    local_max_y = ys[i * 2 + 1]
                                        
                    # rather than seeing the distance, see the grid is inside or not
                    start_index = int((local_min_y.Y - min_y) / unit) + 1
                    end_index   = int((local_max_y.Y - min_y) / unit) + 1
                    
                    for y_index in range(start_index, end_index):
                        
                        y = min_y + unit * y_index
                        
                        grid_pt = rg.Point3d(x, y, z)
                    
                        grid_plane = rg.Plane(grid_pt, rg.Plane.WorldXY.ZAxis)
                        box = rg.Box(grid_plane, unit_interval, unit_interval, unit_interval)
                        V.append(box)
                        P.append(grid_pt)
# ---------- end ghpython_script_2 ----------

# ---- group: Voxlizer
ghpython_script_3 = GhPythonScript(Code=read_file, Mesh=mesh, Size=number_slider)  # -> Out, C, E, V, S, D

# ----
# Click here to run
button = Button()

update = Button()  # disabled
python = GhPythonScript(root=c_script.RootPath, update=update, n_buildings=ghpython_script_3.C)  # -> out, best_x; disabled
# ---------- python: Python ----------
__author__ = "leeuack"
__version__ = "2023.02.15"

import rhinoscriptsyntax as rs
import os


def saveFile(data, root, filename):
    file_dir = os.path.join(root,filename)
    f2 = open(file_dir, 'w')
    f2.write("{}".format(data))
    f2.close()
    
def loadFile(root, filename):
    file_dir = os.path.join(root, filename)
    f = open(file_dir, 'r')
    linelist = f.readline()
    f.close()
    return eval(linelist)



# 1. write params for optimization
saveFile(n_buildings,root,'n_buildings.anything')

# 2. run the optimization script
if update:
    disk = root.split("\\")[0]
    print(disk)
    os.system('{} & cd {} & python pygmo_example_advance_moo.py'.format(disk, root))    

# 3. load the optimization results
best_x = loadFile(root,'advance_best_x.anything')
print(best_x)
# ---------- end python ----------
ghpython_script_4 = GhPythonScript(root=c_script.RootPath)  # -> out, flatten(a), flatten(b), flatten(c), flatten(d), flatten(e); disabled
# ---------- ghpython_script_4: Python ----------
__author__ = "dnf19"
__version__ = "2023.03.11"

import rhinoscriptsyntax as rs
import os



def load_file(root, filename):
    file_dir = os.path.join(root, filename)
    with open(file_dir, 'r') as f:
        lines = f.readlines()
        return [eval(line) for line in lines]
        

a = load_file(root, 'A.anything')
b = load_file(root, 'B.anything')
c = load_file(root, 'C.anything')
d = load_file(root, 'D.anything')
e = load_file(root, 'E.anything')
# ---------- end ghpython_script_4 ----------

# ----
# Wave Function Collapse
ghpython_script_5 = GhPythonScript(
    root=c_script.RootPath,
    update=button,
    points=ghpython_script_3.S,
    dimension=ghpython_script_3.D,
    module_number=Slider(4, range=0..10))  # -> out, simplify(output_list); inputs module_number: Int32
# ---------- ghpython_script_5: Python ----------
__author__ = "dnf19"
__version__ = "2023.03.09"

import rhinoscriptsyntax as rs
import os
import ghpythonlib.treehelpers as th


def saveFile(data, root, filename):
    file_dir = os.path.join(root,filename)
    f2 = open(file_dir, 'w')
    f2.write("{}".format(data))
    f2.close()
    
def load_file(root, filename):
    file_dir = os.path.join(root, filename)
    with open(file_dir, 'r') as f:
        lines = f.readlines()
        return [eval(line) for line in lines]
        
        
# 1. write the file to python

saveFile(points,root,'points.anything')
saveFile(dimension,root,'dimension.anything')


# 2. run the optimization script
if update:
    disk = root.split("\\")[0]
    print(disk)
    os.system('{} & cd {} & main.py'.format(disk, root))

# 3. load the optimization results
#a = load_file(root, '0.anything')
#b = load_file(root, '1.anything')
#c = load_file(root, '2.anything')
#d = load_file(root, '3.anything')

output_list = []
for i in range(module_number):
    filename = str(i) + '.anything'
    a = load_file(root, filename)
    output_list.append(a)
# ---------- end ghpython_script_5 ----------

ghpython_script_6 = GhPythonScript(coords=reverse(ghpython_script_5.output_list))  # -> out, simplify(points)
# ---------- ghpython_script_6: Python ----------
__author__ = "dnf19"
__version__ = "2023.03.11"

import rhinoscriptsyntax as rs
import Rhino.Geometry as rg


points = []
for i, coords in enumerate(coords):
    points.append(rg.Point3d(coords[0], coords[1], coords[2]))
# ---------- end ghpython_script_6 ----------
number_slider_2 = Slider(0.5, range=0..1)
brep_4 = Brep(simplify(graft([<brep referenced from the Rhino model> x4])))
center_box = CenterBox(Base=flatten(ghpython_script_6.points), X=number_slider_2, Y=number_slider_2, Z=number_slider_2)
list_length = ListLength(List=center_box)
box = Box(brep_4)
list_length_2 = ListLength(List=ghpython_script_3.C)
volume = Volume(Geometry=box)  # -> Volume, Centroid
vector_2pt = Vector2Pt(PointA=volume.Centroid, PointB=ghpython_script_6.points, Unitize=False)  # -> Vector, Length
division = Division(A=list_length, B=list_length_2)
panel_2 = Panel(division)
move = Move(Geometry=brep_4, Motion=vector_2pt.Vector)  # -> Geometry, Transform
explode_tree = ExplodeTree(Data=move.Geometry)  # -> Branch0, Branch1, Branch2, Branch3
custom_preview = CustomPreview(Geometry=center_box, Material=ColourSwatch(SwatchColor=RGBA(196, 135, 135, 97)))
custom_preview_2 = CustomPreview(
    Geometry=[explode_tree.Branch0, explode_tree.Branch1, explode_tree.Branch2, explode_tree.Branch3],
    Material=ColourSwatch(SwatchColor=RGB(29, 170, 191)))
